# Grasshopper definition ar-flohmarkt2.gh (Grasshopper 1.0.7)
# plug-ins: FologramForGrasshopper, Squid (ShapeDiver Edition), LunchBox, Pufferfish

number_slider = Slider(0.2, range=0..0.3)
connected_devices = ConnectedDevices(device_filter=1, hasSerializedData=True)  # disabled
connected_devices_2 = ConnectedDevices(device_filter=2, hasSerializedData=True)  # disabled
list_item = ListItem(List=connected_devices, Index=1, Wrap=False)
track_pointers = TrackPointers(Device=list_item, hasSerializedData=True, update_mode=2)
xy_plane = XYPlane(Origin=Point(0, 0, 0))
square = Square(Plane=PlaneXY(0, 0, 0), Size=Slider(1, range=0..1), ExtentX=Slider(6, range=0..100), ExtentY=Slider(4, range=0..100))  # -> Cells, Points
track_pointers_2 = TrackPointers(Device=connected_devices_2, hasSerializedData=True, update_mode=2)
xy_plane_2 = XYPlane(Origin=Point(0, 0, 0))
connected_devices_3 = ConnectedDevices(device_filter=1, hasSerializedData=True)
line_plane = LinePlane(Line=track_pointers, Plane=xy_plane)  # -> Point, ParamL, ParamP
line_plane_2 = LinePlane(Line=track_pointers_2, Plane=xy_plane_2)  # -> Point, ParamL, ParamP
list_item_2 = ListItem(List=connected_devices_3, Index=0, Wrap=True)
data_recorder = DataRecorder(line_plane.Point, DataLimit=-10, RecordData=True)
track_pointers_3 = TrackPointers(Device=list_item_2, hasSerializedData=True, update_mode=2)
xy_plane_3 = XYPlane(Origin=Point(0, 0, 0))
data_recorder_2 = DataRecorder(line_plane_2.Point, DataLimit=-10, RecordData=True)
geometry = Geometry(square.Cells)
line_plane_3 = LinePlane(Line=track_pointers_3, Plane=xy_plane_3)  # -> Point, ParamL, ParamP
geometry_2 = Geometry(square.Cells)
area = Area(Geometry=geometry_2)  # -> Area, flatten(Centroid)
closest_points = ClosestPoints(Point=data_recorder, Cloud=area.Centroid, Count=1)  # -> ClosestPoint, flatten(CPIndex), Distance
data_recorder_3 = DataRecorder(line_plane_3.Point, DataLimit=-10, RecordData=True)
geometry_3 = Geometry(square.Cells)
area_2 = Area(Geometry=geometry_3)  # -> Area, flatten(Centroid)
closest_points_2 = ClosestPoints(Point=data_recorder_2, Cloud=area_2.Centroid, Count=1)  # -> ClosestPoint, flatten(CPIndex), Distance
area_3 = Area(Geometry=geometry)  # -> Area, flatten(Centroid)
list_item_3 = ListItem(List=flatten(geometry_2), Index=closest_points.CPIndex, Wrap=True)  # -> flatten(Item)
list_item_4 = ListItem(List=flatten(geometry_3), Index=closest_points_2.CPIndex, Wrap=True)  # -> flatten(Item)
closest_points_3 = ClosestPoints(Point=data_recorder_3, Cloud=area_3.Centroid, Count=1)  # -> ClosestPoint, flatten(CPIndex), Distance
sort_duplicate_curves = SortDuplicateCurves(Curves=list_item_3)  # -> UniqueCurves, Indices
sort_duplicate_curves_2 = SortDuplicateCurves(Curves=list_item_4)  # -> UniqueCurves, Indices
list_length = ListLength(List=sort_duplicate_curves.Indices)  # -> flatten(Length)
list_length_2 = ListLength(List=sort_duplicate_curves_2.Indices)  # -> flatten(Length)
list_item_5 = ListItem(List=flatten(geometry), Index=closest_points_3.CPIndex, Wrap=True)  # -> flatten(Item)
odd_even_numbers = OddEvenNumbers(Numbers=list_length, Placeholders=True)  # -> Odd, Even
odd_even_numbers_2 = OddEvenNumbers(Numbers=list_length_2, Placeholders=True)  # -> Odd, Even
sort_duplicate_curves_3 = SortDuplicateCurves(Curves=list_item_5)  # -> UniqueCurves, Indices
equality = Equality(FirstNumber=list_length, SecondNumber=odd_even_numbers.Odd)  # -> Equality, Inequality
list_length_3 = ListLength(List=sort_duplicate_curves_3.Indices)  # -> flatten(Length)
equality_2 = Equality(FirstNumber=list_length_2, SecondNumber=odd_even_numbers_2.Odd)  # -> Equality, Inequality
odd_even_numbers_3 = OddEvenNumbers(Numbers=list_length_3, Placeholders=True)  # -> Odd, Even
replace_nulls = ReplaceNulls(Items=equality.Equality, Replacements="False")  # -> Items, Count
cull_pattern = CullPattern(List=sort_duplicate_curves.UniqueCurves, CullPattern=replace_nulls.Items)
region_union = RegionUnion(Curves=cull_pattern)
boundary_surfaces = BoundarySurfaces(Edges=region_union)
replace_nulls_2 = ReplaceNulls(Items=equality_2.Equality, Replacements="False")  # -> Items, Count
cull_pattern_2 = CullPattern(List=sort_duplicate_curves_2.UniqueCurves, CullPattern=replace_nulls_2.Items)
area_4 = Area(Geometry=cull_pattern_2)  # -> Area, Centroid
region_union_2 = RegionUnion(Curves=cull_pattern_2)
boundary_surfaces_2 = BoundarySurfaces(Edges=region_union_2)
equality_3 = Equality(FirstNumber=list_length_3, SecondNumber=odd_even_numbers_3.Odd)  # -> Equality, Inequality
area_5 = Area(Geometry=boundary_surfaces)  # -> Area, Centroid
area_6 = Area(Geometry=boundary_surfaces_2)  # -> Area, Centroid
replace_nulls_3 = ReplaceNulls(Items=equality_3.Equality, Replacements="False")  # -> Items, Count
cull_pattern_3 = CullPattern(List=sort_duplicate_curves_3.UniqueCurves, CullPattern=replace_nulls_3.Items)
region_union_3 = RegionUnion(Curves=cull_pattern_3)
area_7 = Area(Geometry=cull_pattern_3)  # -> Area, Centroid
boundary_surfaces_3 = BoundarySurfaces(Edges=region_union_3)
round = Round(Number=area_5.Area)  # -> Nearest, Floor, Ceiling
round_2 = Round(Number=area_6.Area)  # -> Nearest, Floor, Ceiling
area_8 = Area(Geometry=boundary_surfaces_3)  # -> Area, Centroid
entwine = Entwine(Branch00=round.Nearest, Branch01="m2", FlattenInputs=True)  # -> flatten(Result)
entwine_2 = Entwine(Branch00=round_2.Nearest, Branch01="m2", FlattenInputs=True)  # -> flatten(Result)
round_3 = Round(Number=area_8.Area)  # -> Nearest, Floor, Ceiling
text_join = TextJoin(Text=flatten(entwine), Join=" ")
font = Font(Family="Arial", Size=number_slider, Bold=False, Italic=False, Underline=False)
text_join_2 = TextJoin(Text=flatten(entwine_2), Join=" ")
font_2 = Font(Family="Arial", Size=number_slider, Bold=False, Italic=False, Underline=False)
geometry_4 = Geometry([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])
entwine_3 = Entwine(Branch00=round_3.Nearest, Branch01="m2", FlattenInputs=True)  # -> flatten(Result)
text_curves = TextCurves(Plane=PlaneXY(0, 0, 0), Text=text_join, Font=font)
text_curves_2 = TextCurves(Plane=PlaneXY(0, 0, 0), Text=text_join_2, Font=font_2)
text_curves_3 = TextCurves(Plane=PlaneXY(0, 0, 0), Text="Max", Font=font)
solid_union = SolidUnion(Breps=geometry_4)
text_join_3 = TextJoin(Text=flatten(entwine_3), Join=" ")
text_curves_4 = TextCurves(Plane=PlaneXY(0, 0, 0), Text="Max", Font=font_2)
font_3 = Font(Family="Arial", Size=number_slider, Bold=False, Italic=False, Underline=False)
bounding_box = BoundingBox(Content=text_curves, Plane=PlaneXY(0, 0, 0), UnionBox=True)  # -> Box, Box_2
multiplication = Multiplication(A=number_slider, B=1.5)
bounding_box_2 = BoundingBox(Content=text_curves_2, Plane=PlaneXY(0, 0, 0), UnionBox=True)  # -> Box, Box_2
multiplication_2 = Multiplication(A=number_slider, B=1.5)
text_curves_5 = TextCurves(Plane=PlaneXY(0, 0, 0), Text=text_join_3, Font=font_3)
area_9 = Area(Geometry=bounding_box.Box)  # -> Area, Centroid
vector_2pt = Vector2Pt(PointA=area_9.Centroid, PointB=area_5.Centroid, Unitize=False)  # -> Vector, Length
text_curves_6 = TextCurves(Plane=PlaneXY(0, 0, 0), Text="Amanda", Font=font_3)
area_10 = Area(Geometry=bounding_box_2.Box)  # -> Area, Centroid
vector_2pt_2 = Vector2Pt(PointA=area_10.Centroid, PointB=area_6.Centroid, Unitize=False)  # -> Vector, Length
vector_xyz = VectorXYZ(XComponent=0, YComponent=multiplication, ZComponent=0)  # -> Vector, Length
move = Move(Geometry=text_curves_3, Motion=vector_2pt.Vector)  # -> Geometry, Transform
vector_xyz_2 = VectorXYZ(XComponent=0, YComponent=multiplication_2, ZComponent=0)  # -> Vector, Length
bounding_box_3 = BoundingBox(Content=text_curves_5, Plane=PlaneXY(0, 0, 0), UnionBox=True)  # -> Box, Box_2
move_2 = Move(Geometry=text_curves_4, Motion=vector_2pt_2.Vector)  # -> Geometry, Transform
multiplication_3 = Multiplication(A=number_slider, B=1.5)
move_3 = Move(Geometry=text_curves, Motion=vector_2pt.Vector)  # -> Geometry, Transform
move_4 = Move(Geometry=text_curves_2, Motion=vector_2pt_2.Vector)  # -> Geometry, Transform
area_11 = Area(Geometry=bounding_box_3.Box)  # -> Area, Centroid
vector_2pt_3 = Vector2Pt(PointA=area_11.Centroid, PointB=area_8.Centroid, Unitize=False)  # -> Vector, Length
unit_z = UnitZ(Factor=Slider(0.01, range=0..0.01))
move_5 = Move(Geometry=move.Geometry, Motion=vector_xyz.Vector)  # -> Geometry, Transform
unit_z_2 = UnitZ(Factor=Slider(0.01, range=0..0.01))
move_6 = Move(Geometry=move_2.Geometry, Motion=vector_xyz_2.Vector)  # -> Geometry, Transform
vector_xyz_3 = VectorXYZ(XComponent=0, YComponent=multiplication_3, ZComponent=0)  # -> Vector, Length
move_7 = Move(Geometry=text_curves_6, Motion=vector_2pt_3.Vector)  # -> Geometry, Transform
move_8 = Move(Geometry=[move_5.Geometry, move_3.Geometry], Motion=unit_z)  # -> Geometry, Transform
move_9 = Move(Geometry=[move_6.Geometry, move_4.Geometry], Motion=unit_z_2)  # -> Geometry, Transform
move_10 = Move(Geometry=text_curves_5, Motion=vector_2pt_3.Vector)  # -> Geometry, Transform
vector_2pt_4 = Vector2Pt(PointA="0.5,0.5,0", PointB=area_7.Centroid, Unitize=False)  # -> Vector, Length
vector_2pt_5 = Vector2Pt(PointA="0.5,0.5,0", PointB=area_4.Centroid, Unitize=False)  # -> Vector, Length
unit_z_3 = UnitZ(Factor=Slider(0.01, range=0..0.01))
move_11 = Move(Geometry=move_7.Geometry, Motion=vector_xyz_3.Vector)  # -> Geometry, Transform
move_12 = Move(Geometry=[move_11.Geometry, move_10.Geometry], Motion=unit_z_3)  # -> Geometry, Transform
move_13 = Move(Geometry=solid_union, Motion=vector_2pt_4.Vector)  # -> Geometry, Transform
move_14 = Move(Geometry=solid_union, Motion=vector_2pt_5.Vector)  # -> Geometry, Transform
sync_object = SyncObject(
    GM=flatten(geometry),
    AlwaysIncludeTextureCoordinates=False,
    Clickable=False,
    DefaultCurveThicknessMillimeters=10,
    DefaultGlossPercent=0,
    DefaultMaterialColor=RGB(255, 255, 255),
    DefaultSpecularPercent=0,
    Grabbable=False,
    Interactive=False,
    Occlusion=False,
    Outline=True,
    hasSerializedData=True)
sync_object_2 = SyncObject(
    GM=boundary_surfaces,
    AlwaysIncludeTextureCoordinates=False,
    Clickable=False,
    DefaultCurveThicknessMillimeters=2.5,
    DefaultGlossPercent=0,
    DefaultMaterialColor=RGB(208, 255, 0),
    DefaultSpecularPercent=0,
    Grabbable=False,
    Interactive=False,
    Occlusion=False,
    Outline=False,
    hasSerializedData=True)
sync_object_3 = SyncObject(
    GM=[boundary_surfaces_2, move_14.Geometry],
    AlwaysIncludeTextureCoordinates=False,
    Clickable=False,
    DefaultCurveThicknessMillimeters=2.5,
    DefaultGlossPercent=0,
    DefaultMaterialColor=RGB(208, 255, 0),
    DefaultSpecularPercent=0,
    Grabbable=False,
    Interactive=False,
    Occlusion=False,
    Outline=False,
    hasSerializedData=True)
sync_object_4 = SyncObject(
    GM=flatten([move_12.Geometry, move_9.Geometry]),
    AlwaysIncludeTextureCoordinates=False,
    Clickable=False,
    DefaultCurveThicknessMillimeters=10,
    DefaultGlossPercent=0,
    DefaultMaterialColor=RGB(46, 46, 46),
    DefaultSpecularPercent=0,
    Grabbable=False,
    Interactive=False,
    Occlusion=False,
    Outline=True,
    hasSerializedData=True)
sync_object_5 = SyncObject(
    GM=flatten([boundary_surfaces_3, move_13.Geometry]),
    AlwaysIncludeTextureCoordinates=False,
    Clickable=False,
    DefaultCurveThicknessMillimeters=2.5,
    DefaultGlossPercent=0,
    DefaultMaterialColor=RGB(0, 255, 13),
    DefaultSpecularPercent=0,
    Grabbable=False,
    Interactive=False,
    Occlusion=False,
    Outline=False,
    hasSerializedData=True)
